# Dynamo graph Mining Program Data.dyn (Dynamo 2.3.0.5885)
# packages: Data-Shapes 2019.2.42

# group: Logo File Path
file_path = Filename("..\..\..\..\KnowledgeMgmt\ReCouncil\00_Templates and Processes\CGA Assets\CGA Logo Image.jpg")

# group: Getting Phases
getting_phases = Python()
# ---------- getting_phases.python (67 lines) ----------
# Enable Python support and load DesignScript library
import clr
clr.AddReference('ProtoGeometry')
from Autodesk.DesignScript.Geometry import *

clr.AddReference('RevitNodes')
import Revit
clr.ImportExtensions(Revit.Elements)

clr.ImportExtensions(Revit.GeometryConversion)

clr.AddReference('RevitServices')
import RevitServices
from RevitServices.Persistence import DocumentManager
from RevitServices.Transactions import TransactionManager
from System.Collections.Generic import *

clr.AddReference('RevitAPI')
import Autodesk
from Autodesk.Revit.DB import *

clr.AddReference('DSCoreNodes')
import DSCore
from DSCore.List import *

def uniqueVals(_listInput):
	_listOut = [_listInput[0]]
	for i,_item in enumerate(_listInput):
		if i > 0:
			unique = True
			for _comparison in _listOut:
				if _comparison == _item:
					unique = False
					break
			if unique:
				_listOut.append(_item)
	return _listOut


doc = DocumentManager.Instance.CurrentDBDocument
uiapp = DocumentManager.Instance.CurrentUIApplication
app = uiapp.Application
uidoc = DocumentManager.Instance.CurrentUIApplication.ActiveUIDocument

phaseNames = []
phaseIds = []
for phase in doc.Phases:
	phaseNames.append(phase.Name)
	phaseIds.append(phase.Id)

rooms = FilteredElementCollector(doc).OfCategory(BuiltInCategory.OST_Rooms).WhereElementIsNotElementType().ToElements()

roomsInPhase = []
roomPhases = []
for room in rooms:
	roomPhases.append(room.get_Parameter(BuiltInParameter.ROOM_PHASE).AsValueString())

for phase in phaseNames:
	roomCounter = 0
	for roomPhase in roomPhases:
		if phase == roomPhase:
			roomCounter += 1
	roomsInPhase.append(roomCounter)
		


OUT = [phaseNames,roomsInPhase]
# ----------------------------------------
code_block = CodeBlock(OUT=getting_phases) { allPhases = OUT[0]; countOfRoomsPerPhase = OUT[1]; }

# group: Bar Chart of Phases Room Counts
code_block_2 = CodeBlock { chartName = "phase distribution of rooms"; seriesName = "rooms"; xAxisTitle = "phases"; yAxisTitle = "count of rooms"; }
code_block_3 = CodeBlock { 254; 195; 41; }
byARGB = Color.ByARGB(r=code_block_3.out0, g=code_block_3.out1, b=code_block_3.out2)
barChart = Custom[UI.BarChart](Chart_name=code_block_2.chartName, Series_names=code_block_2.seriesName, X_values=code_block.allPhases, Y_values=code_block.countOfRoomsPerPhase, Chart_colors_optionnal=byARGB, X_Axis_Label_optionnal=code_block_2.xAxisTitle, Y_Axis_Label_optionnal=code_block_2.yAxisTitle)  # package Data-Shapes; BarChart

# group: Phase Selection
code_block_4 = CodeBlock { listViewName = "select phases"; listViewHeight = 300; }
ui_listview_data = Custom[UI.Listview Data](InputName=code_block_4.listViewName, Keys=code_block.allPhases, Values=code_block.allPhases, Height_optionnal=code_block_4.listViewHeight)  # package Data-Shapes; Create data for ListView input in UI.MultiInputForm ++ . Check out www.data-shapes.net for more infos.

# group: Phase Filter Interface
code_block_5 = CodeBlock { description = "Phase Selection"; buttonText = "Select Phases"; }
list_create = List.Create(item0=barChart, item1=ui_listview_data)
boolean = BoolSelector(true)
code_block_6 = CodeBlock { cancelButton = "STOP"; maxHeight = 1000; interfaceWidth = 600; }
ui_multipleinputform = Custom[UI.MultipleInputForm ++](Description_optional=code_block_5.description, Logo_optional=file_path, ButtonText_optional=code_block_5.buttonText, Inputs=list_create, Toggle=boolean, CancelButtonText_optional=code_block_6.cancelButton, MaxHeight_optional=code_block_6.maxHeight, Width_optional=code_block_6.interfaceWidth)  # package Data-Shapes; Create a form with multiple inputs. see www.data-shapes.net for tutorials and infos!
flatten = List.Flatten(list=ui_multipleinputform.User_Inputs)

# group: Filtering By Phase and Getting Depts
filtering_rooms_by_phases_and = Python(IN[0]=flatten)  # "Filtering Rooms by Phases and Finding Departments"
# ---------- filtering_rooms_by_phases_and.python (68 lines) ----------
# Enable Python support and load DesignScript library
import clr
clr.AddReference('ProtoGeometry')
from Autodesk.DesignScript.Geometry import *

clr.AddReference('RevitNodes')
import Revit
clr.ImportExtensions(Revit.Elements)

clr.ImportExtensions(Revit.GeometryConversion)

clr.AddReference('RevitServices')
import RevitServices
from RevitServices.Persistence import DocumentManager
from RevitServices.Transactions import TransactionManager
from System.Collections.Generic import *

clr.AddReference('RevitAPI')
import Autodesk
from Autodesk.Revit.DB import *

clr.AddReference('DSCoreNodes')
import DSCore
from DSCore.List import *

def uniqueVals(_listInput):
	_listOut = [_listInput[0]]
	for i,_item in enumerate(_listInput):
		if i > 0:
			unique = True
			for _comparison in _listOut:
				if _comparison == _item:
					unique = False
					break
			if unique:
				_listOut.append(_item)
	return _listOut


doc = DocumentManager.Instance.CurrentDBDocument
uiapp = DocumentManager.Instance.CurrentUIApplication
app = uiapp.Application
uidoc = DocumentManager.Instance.CurrentUIApplication.ActiveUIDocument

selectedPhases = IN[0]

if type(selectedPhases) != list:
	selectedPhases = [selectedPhases]

rooms = FilteredElementCollector(doc).OfCategory(BuiltInCategory.OST_Rooms).WhereElementIsNotElementType().ToElements()

filteredDepartments = []
for room in rooms:
	for phase in selectedPhases:
		if room.get_Parameter(BuiltInParameter.ROOM_PHASE).AsValueString() == phase:
			filteredDepartments.append(room.LookupParameter("Department").AsString())

uniqueDepartments = uniqueVals(filteredDepartments)
departmentCounts = []

for uniqueDept in uniqueDepartments:
	deptCount = 0
	for dept in filteredDepartments:
		if uniqueDept == dept:
			deptCount += 1
	departmentCounts.append(deptCount)

OUT = [uniqueDepartments,departmentCounts]
# ----------------------------------------
code_block_7 = CodeBlock(OUT=filtering_rooms_by_phases_and) { departmentNames = OUT[0]; departmentCounts = OUT[1]; }

# group: Bar Chart of Dept Room Counts
code_block_8 = CodeBlock()
# ---------- code_block_8.designscript (4 lines) ----------
chartName = "department distribution of rooms";
seriesName = "rooms";
xAxisTitle = "departments";
yAxisTitle = "count of rooms";
# ----------------------------------------
code_block_9 = CodeBlock { 254; 195; 41; }
byARGB_2 = Color.ByARGB(r=code_block_9.out0, g=code_block_9.out1, b=code_block_9.out2)
barChart_2 = Custom[UI.BarChart](Chart_name=code_block_8.chartName, Series_names=code_block_8.seriesName, X_values=code_block_7.departmentNames, Y_values=code_block_7.departmentCounts, Chart_colors_optionnal=byARGB_2, X_Axis_Label_optionnal=code_block_8.xAxisTitle, Y_Axis_Label_optionnal=code_block_8.yAxisTitle)

# group: Department Selection
code_block_10 = CodeBlock { listViewName = "select departments"; listViewHeight = 300; }
ui_listview_data_2 = Custom[UI.Listview Data](InputName=code_block_10.listViewName, Keys=code_block_7.departmentNames, Values=code_block_7.departmentNames, Height_optionnal=code_block_10.listViewHeight)

# group: Department Filter Interface
code_block_11 = CodeBlock { description = "Department Selection"; buttonText = "Select Departments"; }
list_create_2 = List.Create(item0=barChart_2, item1=ui_listview_data_2)
code_block_12 = CodeBlock { cancelButton = "STOP"; maxHeight = 1000; interfaceWidth = 600; }
ui_multipleinputform_2 = Custom[UI.MultipleInputForm ++](Description_optional=code_block_11.description, Logo_optional=file_path, ButtonText_optional=code_block_11.buttonText, Inputs=list_create_2, Toggle=ui_multipleinputform.Was_Run, CancelButtonText_optional=code_block_12.cancelButton, MaxHeight_optional=code_block_12.maxHeight, Width_optional=code_block_12.interfaceWidth)
flatten_2 = List.Flatten(list=ui_multipleinputform_2.User_Inputs)

# group: Filtering by Phase and Department
finding_room_levels_with_phase = Python(IN[0]=flatten, IN[1]=flatten_2)  # "Finding Room Levels with Phase and Department Filter"
# ---------- finding_room_levels_with_phase.python (83 lines) ----------
# Enable Python support and load DesignScript library
import clr
clr.AddReference('ProtoGeometry')
from Autodesk.DesignScript.Geometry import *

clr.AddReference('RevitNodes')
import Revit
clr.ImportExtensions(Revit.Elements)

clr.ImportExtensions(Revit.GeometryConversion)

clr.AddReference('RevitServices')
import RevitServices
from RevitServices.Persistence import DocumentManager
from RevitServices.Transactions import TransactionManager
from System.Collections.Generic import *

clr.AddReference('RevitAPI')
import Autodesk
from Autodesk.Revit.DB import *

clr.AddReference('DSCoreNodes')
import DSCore
from DSCore.List import *

def uniqueVals(_listInput):
	_listOut = [_listInput[0]]
	for i,_item in enumerate(_listInput):
		if i > 0:
			unique = True
			for _comparison in _listOut:
				if _comparison == _item:
					unique = False
					break
			if unique:
				_listOut.append(_item)
	return _listOut


doc = DocumentManager.Instance.CurrentDBDocument
uiapp = DocumentManager.Instance.CurrentUIApplication
app = uiapp.Application
uidoc = DocumentManager.Instance.CurrentUIApplication.ActiveUIDocument

selectedPhases = IN[0]
selectedDepartments = IN[1]

if type(selectedPhases) != list:
	selectedPhases = [selectedPhases]
if type(selectedDepartments) != list:
	selectedDepartments = [selectedDepartments]
	
rooms = FilteredElementCollector(doc).OfCategory(BuiltInCategory.OST_Rooms).WhereElementIsNotElementType().ToElements()

filteredLevels = []
for room in rooms:
	phaseMatched = False
	deptMatched = False
	for phase in selectedPhases:
		if room.get_Parameter(BuiltInParameter.ROOM_PHASE).AsValueString() == phase:
			phaseMatched = True
			break
	for dept in selectedDepartments:
		if room.LookupParameter("Department").AsString() == dept:
			deptMatched = True
			break
	if phaseMatched and deptMatched:
		filteredLevels.append(room.Level)

levelNames = []
for level in filteredLevels:
	levelNames.append(level.Name)
uniqueLevelNames = uniqueVals(levelNames)

levelCounts = []
for levelName in uniqueLevelNames:
	levelCounter = 0
	for level in filteredLevels:
		if level.Name == levelName:
			levelCounter += 1
	levelCounts.append(levelCounter)

OUT = [uniqueLevelNames,levelCounts]
# ----------------------------------------
code_block_13 = CodeBlock(OUT=finding_room_levels_with_phase) { levelNames = OUT[0]; levelCounts = OUT[1]; }

# group: Bar Chart of Level Room Counts
code_block_14 = CodeBlock { chartName = "level distribution of rooms"; seriesName = "rooms"; xAxisTitle = "levels"; yAxisTitle = "count of rooms"; }
code_block_15 = CodeBlock { 254; 195; 41; }
byARGB_3 = Color.ByARGB(r=code_block_15.out0, g=code_block_15.out1, b=code_block_15.out2)
barChart_3 = Custom[UI.BarChart](Chart_name=code_block_14.chartName, Series_names=code_block_14.seriesName, X_values=code_block_13.levelNames, Y_values=code_block_13.levelCounts, Chart_colors_optionnal=byARGB_3, X_Axis_Label_optionnal=code_block_14.xAxisTitle, Y_Axis_Label_optionnal=code_block_14.yAxisTitle)

# group: Level Selection
code_block_16 = CodeBlock { listViewName = "select levels"; listViewHeight = 300; }
ui_listview_data_3 = Custom[UI.Listview Data](InputName=code_block_16.listViewName, Keys=code_block_13.levelNames, Values=code_block_13.levelNames, Height_optionnal=code_block_16.listViewHeight)

# group: Level Filter Interface
code_block_17 = CodeBlock { description = "Level Selection"; buttonText = "Select Levels"; }
list_create_3 = List.Create(item0=barChart_3, item1=ui_listview_data_3)
code_block_18 = CodeBlock { cancelButton = "STOP"; maxHeight = 1000; interfaceWidth = 600; }
ui_multipleinputform_3 = Custom[UI.MultipleInputForm ++](Description_optional=code_block_17.description, Logo_optional=file_path, ButtonText_optional=code_block_17.buttonText, Inputs=list_create_3, Toggle=ui_multipleinputform_2.Was_Run, CancelButtonText_optional=code_block_18.cancelButton, MaxHeight_optional=code_block_18.maxHeight, Width_optional=code_block_18.interfaceWidth)
flatten_3 = List.Flatten(list=ui_multipleinputform_3.User_Inputs)

# group: Getting Room Data
aprox_division_distance_for = CodeBlock { aproxDivisionDistance = 2; }  # "Aprox Division Distance for Curvilinear Geometry"
building_room_dataset = Python(IN[0]=aprox_division_distance_for, IN[1]=flatten, IN[2]=flatten_2, IN[3]=flatten_3)
# ---------- building_room_dataset.python (137 lines) ----------
import math

# Enable Python support and load DesignScript library
import clr
clr.AddReference('ProtoGeometry')
from Autodesk.DesignScript.Geometry import *

clr.AddReference('RevitNodes')
import Revit
clr.ImportExtensions(Revit.Elements)

clr.ImportExtensions(Revit.GeometryConversion)

clr.AddReference('RevitServices')
import RevitServices
from RevitServices.Persistence import DocumentManager
from RevitServices.Transactions import TransactionManager
from System.Collections.Generic import *

clr.AddReference('RevitAPI')
import Autodesk
from Autodesk.Revit.DB import *

clr.AddReference('DSCoreNodes')
import DSCore
from DSCore.List import *

def uniqueVals(_listInput):
	_listOut = [_listInput[0]]
	for i,_item in enumerate(_listInput):
		if i > 0:
			unique = True
			for _comparison in _listOut:
				if _comparison == _item:
					unique = False
					break
			if unique:
				_listOut.append(_item)
	return _listOut

def getBoundaryCurves(_room):
	_curvesOut = []
	return _room.GetBoundarySegments(SpatialElementBoundaryOptions())


doc = DocumentManager.Instance.CurrentDBDocument
uiapp = DocumentManager.Instance.CurrentUIApplication
app = uiapp.Application
uidoc = DocumentManager.Instance.CurrentUIApplication.ActiveUIDocument

aproxDivisionDistance = IN[0]
selectedPhases = IN[1]
selectedDepts = IN[2]
selectedLevels = IN[3]

if type(selectedPhases) != list:
	selectedPhases = [selectedPhases]
if type(selectedDepts) != list:
	selectedDepts = [selectedDepts]
if type(selectedLevels) != list:
	selectedLevels = [selectedLevels]
	
rooms = FilteredElementCollector(doc).OfCategory(BuiltInCategory.OST_Rooms).WhereElementIsNotElementType().ToElements()

roomData = []
for i, room in enumerate(rooms):
	
	phaseMatched = False
	departmentMatched = False
	levelMatched = False
	for phase in selectedPhases:
		if room.get_Parameter(BuiltInParameter.ROOM_PHASE).AsValueString() == phase:
			phaseMatched = True
	for dept in selectedDepts:
		if room.LookupParameter('Department').AsString() == dept:
			departmentMatched = True
	for level in selectedLevels:
		if room.Level.Name == level:
			levelMatched = True
	
	if room.Area > 0 and phaseMatched and departmentMatched and levelMatched: 
		roomObject = {}
		roomObject["elevation"] = round(room.Level.Elevation)
		roomObject["level"] = room.Level.Name
		roomObject["area"] = room.Area
		
		########Additional parameters can be added to the list below as necessary
		roomObject["name"] = room.LookupParameter('Name').AsString()
		roomObject["department"] = room.LookupParameter('Department').AsString()
		roomObject["number"] = room.LookupParameter('Number').AsString()
		roomObject["occupancy"] = room.LookupParameter('Occupancy').AsString()
		roomObject["base finish"] = room.LookupParameter('Base Finish').AsString()
		roomObject["ceiling finish"] = room.LookupParameter('Ceiling Finish').AsString()
		roomObject["wall finish"] = room.LookupParameter('Wall Finish').AsString()
		roomObject["floor finish"] = room.LookupParameter('Floor Finish').AsString()
		
		roomObject["loopData"] = []
		boundaryCurves = getBoundaryCurves(room)
		
		##############The following for loop is the logic to convert the boundary curves into nested lists of points
		for j, loop in enumerate(boundaryCurves):
			roomObject["loopData"].append({"points":[],"outerLoop":False})
			
			if j == 0:
				roomObject["loopData"][j]["outerLoop"]=True
			
			for curve in loop:
				curveGeom = curve.GetCurve()
				type = curveGeom.GetType().ToString()
				
				if type == "Autodesk.Revit.DB.Line":
					pointDict = {}
					startPoint = curveGeom.GetEndPoint(0)
					pointDict["x"] = startPoint.X
					pointDict["y"] = startPoint.Y
					pointDict["z"] = roomObject["elevation"]
					roomObject["loopData"][j]["points"].append(pointDict)
				else:
					#the logic to run if the line is curved to generate approximating straight segment geometry				
					evalParams = []
					numberOfSteps = math.ceil(curveGeom.Length/aproxDivisionDistance)
					paramStep = 1/numberOfSteps
					for step in range(int(numberOfSteps)):
						evalParams.append((step)*paramStep)
						
					for param in evalParams:
						pointDict = {}
						evalPoint = curveGeom.Evaluate(param,True)
						pointDict["x"] = evalPoint.X
						pointDict["y"] = evalPoint.Y
						pointDict["z"] = roomObject["elevation"]
						roomObject["loopData"][j]["points"].append(pointDict)
		roomData.append(roomObject)
					
				

OUT = roomData
# ----------------------------------------
preview_curves = Python(IN[0]=building_room_dataset)
# ---------- preview_curves.python (63 lines) ----------
# Enable Python support and load DesignScript library
import clr
clr.AddReference('ProtoGeometry')
from Autodesk.DesignScript.Geometry import *

clr.AddReference('RevitNodes')
import Revit
clr.ImportExtensions(Revit.Elements)

clr.ImportExtensions(Revit.GeometryConversion)

clr.AddReference('RevitServices')
import RevitServices
from RevitServices.Persistence import DocumentManager
from RevitServices.Transactions import TransactionManager
from System.Collections.Generic import *

clr.AddReference('RevitAPI')
import Autodesk
from Autodesk.Revit.DB import *

clr.AddReference('DSCoreNodes')
import DSCore
from DSCore.List import *

def uniqueVals(_listInput):
	_listOut = [_listInput[0]]
	for i,_item in enumerate(_listInput):
		if i > 0:
			unique = True
			for _comparison in _listOut:
				if _comparison == _item:
					unique = False
					break
			if unique:
				_listOut.append(_item)
	return _listOut


doc = DocumentManager.Instance.CurrentDBDocument
uiapp = DocumentManager.Instance.CurrentUIApplication
app = uiapp.Application
uidoc = DocumentManager.Instance.CurrentUIApplication.ActiveUIDocument

roomDataIn = IN[0]
boundaryCurves = []

for roomData in roomDataIn:
	for loop in roomData["loopData"]:
		if loop["outerLoop"]:
			pointData = []
			
			for point in loop["points"]:
				revitPoint = XYZ(point["x"],point["y"],point["z"])
				pointData.append(revitPoint)
				
			lastPoint = XYZ(loop["points"][0]["x"],loop["points"][0]["y"],loop["points"][0]["z"])
			pointData.append(lastPoint)
				
			outerBoundary = PolyLine.Create(pointData)
			boundaryCurves.append(outerBoundary.ToProtoType())
			
OUT = boundaryCurves
# ----------------------------------------

# group: Set Export Directory
code_block_19 = CodeBlock { description = "select output directory"; buttonText = "set path"; }
ui_directorypath_data = Custom[UI.DirectoryPath Data](InputName=code_block_19.description, ButtonText=code_block_19.buttonText)  # package Data-Shapes; Creates a DirectoryPath input for UI.MultipleInputForm ++ . Check out www.data-shapes.net for more infos!

# group: Set Export Name
code_block_20 = CodeBlock()
# ---------- code_block_20.designscript (3 lines) ----------
description = "enter project export name (please avoid special characters)";
defaultText = "room data export";
isNumberEntry = false;
# ----------------------------------------
ui_textbox_data = Custom[UI.TextBox Data](InputName=code_block_20.description, DefaultText=code_block_20.defaultText, IsNumberEntry=code_block_20.isNumberEntry)  # package Data-Shapes; Create Data for TextBox input in UI.MultipleInputForm ++ . Check out www.data-shapes.net for more informations

# group: Select Metadata Model
# note: New Metadata models can be added, but logic should also be added to the python script to accomodate the additions.  This script does not generate the metadata, it only makes entries in the json export to accomodate this data.
code_block_21 = CodeBlock { description = "select meta data model"; metaDataModels = ["Education K-12", "Hospital", "Worship"]; }
ui_dropdown_data = Custom[UI.DropDown Data](InputName=code_block_21.description, Keys=code_block_21.metaDataModels, Values=code_block_21.metaDataModels)  # package Data-Shapes; Create data for DropDown input in UI.MultiInputForm ++ . Check out www.data-shapes.net for more infos.

# group: Data Export Interface
code_block_22 = CodeBlock { "Set Export Parameters"; "Finish Export"; }
list_create_4 = List.Create(item0=ui_directorypath_data, item1=ui_textbox_data, item2=ui_dropdown_data)
code_block_23 = CodeBlock { cancelButton = "STOP"; maxHeight = 1000; interfaceWidth = 600; }
ui_multipleinputform_4 = Custom[UI.MultipleInputForm ++](Description_optional=code_block_22.out0, Logo_optional=file_path, ButtonText_optional=code_block_22.out1, Inputs=list_create_4, Toggle=ui_multipleinputform_3.Was_Run, CancelButtonText_optional=code_block_23.cancelButton, MaxHeight_optional=code_block_23.maxHeight, Width_optional=code_block_23.interfaceWidth)
